% Simulink data dictionary cpu2_mc_algorithm.sldd

CurAOffset = Simulink.Parameter(2238, DataType="uint16")
Vbus = Simulink.Parameter(24, DataType="single")
Rs = Simulink.Parameter(0.15, DataType="single")
Ls = Simulink.Parameter(0.00025, DataType="single")
MaxPWM = Simulink.Parameter(0.5, DataType="single")

I_ABC = Simulink.Bus()
  a: single
  b: single
  c: single

CurScale = Simulink.Parameter(0.012, DataType="single")
CurCOffset = Simulink.Parameter(2260, DataType="uint16")
CurBOffset = Simulink.Parameter(2250, DataType="uint16")
RATIO = Simulink.Parameter(100, DataType="single")